% Simulink data dictionary MyCustomDataDictionary.sldd

MyBus2 = Simulink.Bus()
  MyBoolVar2: boolean  % Is Message Available
  MyUint8Var: uint8
  MyDoubleVar: double

MyParameter = EcoObj.Parameter(single([13 96.8]), Min=0, Max=100, Unit="%", StorageClass="Calibration")  % Accelerator pedal driver: Channel1InputRange - 1st channel extreme voltage ratio

MyEnum = enum(DefaultValue="enum1", AddClassNameToEnumNames=true)
  enum1 = 0
  enum2 = 1
  enum3 = 2
  enum4 = 3

MyBus1 = Simulink.Bus()
  MyBoolVar: boolean  % Is Message Available
  MyUint16Var: uint16
  MySingleVar: single
  MyEnumSig: Enum: MyEnum