% Simulink data dictionary MyDataDictionary.sldd

MyBus1 = Simulink.Bus()
  MyBoolVar: boolean  % Is Message Available
  MyUint16Var: uint16
  MySingleVar: single

MyBus2 = Simulink.Bus()
  MyBoolVar2: boolean  % Is Message Available
  MyUint8Var: uint8
  MyDoubleVar: double

MyParameter = EcoObj.Parameter(single([13 96.8]), Min=0, Max=100, Unit="%", StorageClass="Calibration")  % Accelerator pedal driver: Channel1InputRange - 1st channel extreme voltage ratio

MyEnum = enum(DefaultValue="Value0", AddClassNameToEnumNames=true)
  Value0 = 0  % Value0
  Value1 = 1  % Value1
  Value2 = 2  % Description for the value '0x2'
  Value3 = 3  % Description for the value '0x3'
  Value4 = 4  % Description for the value '0x4'
  Value5 = 5  % Description for the value '0x5'
  ERR = 6  % ERR
  NA = 7  % NA