% Simulink data dictionary example.sldd

CAN_MSG_MyMessage_t = Simulink.Bus()
  IsMsgAvl: boolean  % Is Message Available
  MySignal: Enum: MyCanEnum_enum

CAN_MSG_EC_Status_3_t = Simulink.Bus()
  IsMsgAvl: boolean  % Is Message Available
  EC3_Bus_Off_Fault: Enum: MyCanEnum_enum  % CAN communication bus busoff fault  protection
  EC3_CAN_Communication_lost: Enum: MyCanEnum_enum  % CAN communication signal loss protection
  EC3_Current_Flodback: Enum: MyCanEnum_enum  % Output current hysteresis protection
  EC3_DC_Over_Voltage: Enum: MyCanEnum_enum  % DC voltage overvoltage protection
  EC3_DC_Under_Voltage: Enum: MyCanEnum_enum  % Low voltage protection of DC voltage
  EC3_DC_Voltage_Low: Enum: MyCanEnum_enum  % DC undervoltage protection
  EC3_DSP_High_Temperature: Enum: MyCanEnum_enum  % DSP overtemperature protection
  EC3_Fault_Limit_Lockout: Enum: MyCanEnum_enum  % Fault override self-locking protection
  EC3_IGBT_High_Temperature: Enum: MyCanEnum_enum  % Power device overtemperature protection
  EC3_Inverter_Current_Imbalance: Enum: MyCanEnum_enum  % Output current three-phase imbalance protection
  EC3_Inverter_Over_Current_Fault: Enum: MyCanEnum_enum  % Output overcurrent protection
  EC3_Inverter_Over_Temp_Fault: Enum: MyCanEnum_enum  % High temperature protection of power devices
  EC3_Inverter_Temperature_Open: Enum: MyCanEnum_enum  % Open circuit protection of temperature detection sensor
  EC3_Lost_Phase_Fault: Enum: MyCanEnum_enum  % Lost Phase protection
  EC3_Micro_Electronic_Fault: Enum: MyCanEnum_enum  % Microelectronics failure
  EC3_Over_Speed_Fault: Enum: MyCanEnum_enum  % Motor control Over Speed protection
  EC3_Temp_Floadback: Enum: MyCanEnum_enum  % Not enabled

CAN_MSG_EC_Status_2_t = Simulink.Bus()
  IsMsgAvl: boolean  % Is Message Available
  EC2_DC_Current: Enum: MyCanEnum_enum  % DC Current feedback from compressor  data/8
  EC2_Phase_Current: Enum: MyCanEnum_enum  % Phase Current feedback from compressor  data/256

CAN_MSG_EC_Status_1_t = Simulink.Bus()
  IsMsgAvl: boolean  % Is Message Available
  EC1_Board_Temp: Enum: MyCanEnum_enum  % Temperature sensor measured value data/256
  EC1_Compressor_Running_Speed: Enum: MyCanEnum_enum  % Actual speed feedback from compressor
  EC1_DC_Bus_Voltage: Enum: MyCanEnum_enum  % DC Voltage sensor measured value  data/16
  EC1_MOS_Temp: Enum: MyCanEnum_enum  % Temperature sensor measured value data/256

CAN_MSG_AC_Message_t = Simulink.Bus()
  IsMsgAvl: boolean  % Is Message Available
  AC_Enable_Disable_Compressor: Enum: MyCanEnum_enum  % 1=on 0=off
  AC_Set_Speed: Enum: MyCanEnum_enum  % Target speed

MyCanEnum_enum = enum(DefaultValue="Value0", AddClassNameToEnumNames=true)
  Value0 = 0  % Value0
  Value1 = 1  % Value1
  Description_for_the_value__0x2_ = 2  % Description_for_the_value__0x2_
  Description_for_the_value__0x3_ = 3  % Description_for_the_value__0x3_
  Description_for_the_value__0x4_ = 4  % Description_for_the_value__0x4_
  Description_for_the_value__0x5_ = 5  % Description_for_the_value__0x5_
  ERR = 6  % ERR
  NA = 7  % NA